vi "FreqSync.gvi"   [LabVIEW NXG 3.0.0]
inputs:
  "input": c128[]
  "Training codes": c128[]
  "Samples per symbol": f64 = 1
  "error in": error
  "barker code": enum{"5", "7", "11", "random"} = "random"
  "Frame index": i32
  "compensate for phase offset": bool = TRUE
outputs:
  "output": c128[]
  "error out": error
  "slope": f64
  "intercept": f64
  "phase offset": f64
uses:
  NI::Analysis::Generation::Ramp Pattern by Samples.gvi
  NI::Analysis::Conditioning::Unwrap Phase.gvi
  NI::Analysis::Fitting::Linear Fit.gvi
diagram:
  Multiply($"Samples per symbol", $"Frame index") -> w1
  call "BarkerCode.gvi"(barker code=$"barker code") -> (subcodes=w2)
  Multiply(w2, $"Samples per symbol") -> w3
  call "Ramp Pattern by Samples.gvi"(samples=w2, end=w3, exclude end=TRUE) -> (ramp pattern=w4)
  # Estimate phase offset between sub codes
  Complex To Polar(r * e^(i*theta)=$"Training codes") -> (theta=w5)
  call "Unwrap Phase.gvi"(input phase=w5, phase unit="radian in, radian out"(0), error in=$"error in") -> (unwrapped phase=w6, error out=w7)
  # Create a linear array for the x axis
  Divide(x=f64 default, y=4) -> w8
  Subtract(x=w6, y=w8) -> w9
  call "Linear Fit.gvi"(method="Bisquare"(2), y=w9, x=w4, error in=w7) -> (slope=w10, intercept=w11, error out=w12)
  # phase offset at start of message
  case ($"compensate for phase offset") {
    frame False, Default {
      w13 = 0
    }
    frame True {
      # doesn't do anything?
      Multiply(w10, w1) -> w14
      Subtract(x=w11, y=w14) -> w13
    }
  }
  Array Size(array=$input) -> (size(s)=w15)
  # n*phase/sub code length
  # from 0 to N
  Add(w15, 0) -> w16
  Multiply(w10, w16) -> w17
  # create phase compensation array
  call "Ramp Pattern by Samples.gvi"(samples=w16, end=w17, error in=w12) -> (ramp pattern=w18, error out=w19)
  Add(w18, w13) -> w20
  Polar To Complex(r=1, theta=w20) -> (r * e^(i*theta)=w21)
  # compensate by multiplying with e^-j(n*phase/sub code length)
  Multiply($input, w21) -> w22
  $output <- w22
  # phase/subcode length
  $slope <- w10
  # remove sync frame compensation
  call "Unwrap Phase.gvi"(input phase=w20, phase unit="radian in, radian out"(0), error in=w19) -> (error out=w23)
  $"error out" <- w23
  $intercept <- w11
  $"phase offset" <- w13
