vi "ReceiverBlock2.0.gvi"   [LabVIEW NXG 3.0.0]
panel controls:
  "IQ rate": f64 = 160000
  "carrier frequency": f64 = 2450000000
  "gain (dB)": f64 = 10
  "active antenna": string = "RX2"
  "Device names": string = "USRP_06"
  "RF Channel": string = "1"
  "Symbol rate (sym/s)": i32 = 10000
  "filter length": i32 = 8
  "message length (symbols)": i32 = 88
  "sync frame index (symbols)": i32 = 44
  "Power Threshold": f64 = 1e-07
  "Frame sync": bool = TRUE
  "Freq sync": bool = TRUE
  "barker code": enum{"5", "7", "11", "random"} = "random"
  "decoding": bool
  "Interleaver": bool
  "filter parameter": f64 = 0.5
  "number of samples per USRP fetch": i64 = 20000
  "Stop_RX_2": bool
  "milliseconds to wait": u32
  "Reset BER": bool
  "Receive sound": bool
  "window length": i32
  "Extra buffer backwards": i32
panel indicators:
  "actual IQ rate": f64
  "actual carrier frequency": f64
  "actual gain (dB)": f64
  "error out": error
  "dequeueing iteration": i32
  "IQ diagram": c128[]
  "samples/symbol": f64
  "sync frame correlation": f64[]
  "enqueueing iteration": i32
  "size(s)": i32
  "power detector": f64[]
  "number elements in queue": i32
  "current index": i32
  "one package": f64[]
  "BER graph": f64[]
  "Mean_BER": f64
  "current BER": f64
  "Input array size": i32
  "Output array size": i32
  "Correct Size": bool
  "string": string
  "Raw input": f64[]
uses:
  NI::USRP::niUSRP Open Rx Session.gvi
  NI::USRP::niUSRP Configure Signal.gvi
  NI::USRP::niUSRP Initiate.gvi
  NI::USRP::niUSRP Fetch Rx Data (CDB).gvi
  NI::Modulation::MT Pack Bits.gvi
  NI::USRP::niUSRP Abort.gvi
  NI::USRP::niUSRP Close Session.gvi
diagram:
  w1 = $"RF Channel"
  call "niUSRP Open Rx Session.gvi"(device names=$"Device names") -> (session handle out=w2, error out=w3)
  Property Node(instance in=w2, "niUSRP"=w1, error in=w3) -> (error out=w4, instance out=w5)
  call "niUSRP Configure Signal.gvi"(active antenna=$"active antenna", session handle=w5, error in=w4, IQ rate=$"IQ rate", carrier frequency=$"carrier frequency", gain=$"gain (dB)", channel list=w1) -> (session handle out=w6, error out=w7, coerced IQ rate=w8, coerced carrier frequency=w9, coerced gain=w10)
  call "niUSRP Initiate.gvi"(session handle=w6, error in=w7) -> (session handle out=w11, error out=w12)
  Obtain Notifier(element data type=bool TRUE, error in=w12, name="error") -> (error out=w13, notifier out=w14)
  Obtain Queue(element data type=c128[] [], error in=w13) -> (error out=w15, queue out=w16)
  w17 = $"number of samples per USRP fetch"
  s1 = w15  # shift register
  s2 = w16  # shift register
  while (iteration -> i1) {
    Get Notifier Status(notifier=w14) -> (latest notification=w18)
    # Producer loop
    case (w18) {
      frame True {
        w19 = w11
        w20 = s2
        w21 = s1
      }
      frame False {
        call "niUSRP Fetch Rx Data (CDB).gvi"(session handle=w11, error in=s1, number of samples=w17, channel list=w1) -> (session handle out=w19, error out=w22, data=w23)
        Enqueue Element(element=w23, error in=w22, queue=s2) -> (error out=w21, queue out=w20)
        call "NotifyError.gvi"(notifier ref=w14, error in=w21)
      }
    }
    $"enqueueing iteration" <- i1
    next s1 = w21
    next s2 = w20
    stop if w18
  }
  Obtain Queue(element data type=u8[] [], error in=w13) -> (error out=w24, queue out=w25)
  s3 = w15  # shift register
  s4 = w16  # shift register
  s5 = uninitialised  # shift register
  s6 = c128[] []  # shift register
  while (iteration -> i2) {
    # Consumer loop
    w26 = $"barker code"
    w27 = $"sync frame index (symbols)"
    w28 = $"message length (symbols)"
    w29 = $"Symbol rate (sym/s)"
    Dequeue Element(error in=s3, queue=s4) -> (element=w30, queue out=w31)
    Insert Into Array(inArray=s6, new=w30) -> w32
    call "BarkerCode.gvi"() -> (length of one subcode=w33, subcodes=w34)
    Multiply(w33, w34) -> w35
    Add(w28, w35) -> w36
    To Double Precision Float(number=w29) -> w37
    Divide(x=w8, y=w37) -> w38
    To Long Integer(number=w38) -> w39
    Multiply(w36, w39) -> w40
    Multiply(w40, 1) -> w41
    # w42: array to next fetch
    s7 = 0  # shift register
    s8 = uninitialised  # shift register
    s9 = s5  # shift register
    while {
      call "PacketDetector.gvi"(input=w32, index=s7, Power Threshold=$"Power Threshold", window length=$"window length") -> (detected?=w43, Calculated power=w44)
      Array Size(array=w32) -> (size(s)=w45)
      # s7: current index
      Subtract(x=s7, y=$"Extra buffer backwards") -> w46
      Is Greater Than 0(x=w46) -> w47
      case (w47) {
        frame False, Default {
          w48 = s7
          w49 = w41
        }
        frame True {
          Add($"Extra buffer backwards", w41) -> w49
          w48 = w46
        }
      }
      # add buffer
      case (w43) {
        frame False, Default {
          # w51: next index
          Add(s7, $"window length") -> w51
          Subtract(x=w45, y=w51) -> w54
          # check if done
          Is Greater Than 0(x=w54) -> w55
          Not(x=w55) -> w50
          w52 = w15
          w42 = c128[] []
          w53 = s9
        }
        frame True {
          Array Subset(array=w32, index0=w48, length0=w49) -> w56
          Absolute Value(x=w56) -> w57
          $"one package" <- w57
          Add(s7, w41) -> w58
          Subtract(x=w45, y=w58) -> w59
          Is Less Or Equal To 0(x=w59) -> w60
          # if total frame, run receiver block
          # check if total frame
          # Stop while loop if checked whole fetch
          # w45: length of fetch
          case (w60) {
            frame False, Default {
              call "Receiver.gvi"(Interleaver=$Interleaver, Signal in=w56, filter length=$"filter length", filter parameter=$"filter parameter", IQ rate=w8, Symbol rate (sym/s)=w29, error in=w15, message length (symbols)=w28, sync frame index (symbols)=w27, barker code=w26, Frame sync=$"Frame sync", Freq sync=$"Freq sync", decoding=$decoding) -> (IQ diagram=w61, output bit stream=w62, Correlation=w63, error out=w64)
              case ($"Receive sound") {
                frame True {
                  Enqueue Element(element=w62, error in=w64, queue=w25) -> (error out=w52)
                  Array Size(array=w62) -> (size(s)=w65)
                  Is Greater Than 0(x=w65) -> w66
                  case (w66) {
                    frame False, Default { }
                    frame True {
                      call "MT Pack Bits.gvi"(input bit stream=w62, bits per integer=8, packed bit order="MSB first", integer format="Unsigned") -> (output integers=w67)
                      Byte Array To String(encoding="Extended ASCII", unsigned byte array=w67) -> (string=w68)
                      $string <- w68
                    }
                  }
                  w53 = f64[] []
                }
                frame False {
                  call "Example signal.gvi"() -> (output bit stream=w69)
                  call "BER.gvi"(Output bit stream=w62, Input bit stream=w69, Array in=s9, error in=w64, Reset BER=$"Reset BER") -> (Correct Size=w70, Output array size=w71, Input array size=w72, current BER=w73, Mean_BER=w74, BER graph=w75, BER array=w53, error out=w52)
                  $"current BER" <- w73
                  $Mean_BER <- w74
                  $"BER graph" <- w75
                  $"Input array size" <- w72
                  $"Output array size" <- w71
                  $"Correct Size" <- w70
                }
              }
              Array Size(array=w56) -> (size(s)=w76)
              $"size(s)" <- w76
              $"sync frame correlation" <- w63
              $"IQ diagram" <- w61
              w42 = c128[] []
            }
            frame True {
              # if not total frame, append to next fetch
              Array Subset(array=w56, index0=w48) -> w42
              w52 = w15
              w53 = s9
            }
          }
          Subtract(x=w45, y=w58) -> w77
          Is Less Or Equal To 0(x=w77) -> w50
          # w58: Index + frame length
          Wait(time to wait=$"milliseconds to wait")
          # next index = current index + frame length +1
          Add(w58, 1) -> w51
        }
      }
      $"current index" <- s7
      # length to check
      Insert Into Array(inArray=s8, new=w44) -> w78
      $"power detector" <- w78
      next s7 = w51
      next s8 = w78
      next s9 = w53
      stop if w50
    }
    Get Queue Status(queue=w31) -> (# elements in queue=w79)
    $"number elements in queue" <- w79
    Absolute Value(x=w32) -> w80
    $"Raw input" <- w80
    $"samples/symbol" <- w38
    Get Notifier Status(notifier=w14) -> (latest notification=w81, notifier out=w82)
    call "NotifyError.gvi"(notifier ref=w82, Notify anyway=$Stop_RX_2)
    $"dequeueing iteration" <- i2
    next s3 = w52
    next s4 = w31
    next s5 = s9
    next s6 = w42
    stop if w81
  }
  Release Queue(error in=s3, queue=s4) -> (error out=w83)
  call "niUSRP Abort.gvi"(session handle=w19, error in=w83) -> (session handle out=w84, error out=w85)
  call "niUSRP Close Session.gvi"(session handle=w84, error in=w85) -> (error out=w86)
  $"error out" <- w86
  $"actual IQ rate" <- w8
  $"actual carrier frequency" <- w9
  $"actual gain (dB)" <- w10
  call "Sink.gvi"(queue=w25, notifier ref=w14, error in=w24, net address_2="127.0.0.1", sink port=36363)
