vi "TransmitterBlock.gvi"   [LabVIEW NXG 3.0.0]
panel controls:
  "IQ rate": f64 = 160000
  "carrier frequency": f64 = 915000000
  "Active antenna": string = "TX1"
  "stop": bool
  "Device name": string = "USRP_06"
  "gain": f64
  "RF channel": string = "0"
  "filter parameter": f64 = 0.5
  "filter length": i32 = 8
  "Symbol rate (sym/s)": i32 = 10000
  "Barker insert index": i32 = 44
  "message length (bits)": i32 = 88
  "Barker code": enum{"5", "7", "11", "random"} = "11"
  "Padding length": i32 = 111
  "encode": bool
  "Frame sync": bool = TRUE
panel indicators:
  "actual IQ rate": f64
  "actual carrier frequency": f64
  "actual gain (dB)": f64
  "error out": error
  "Baseband Waveform (absolute value)": waveform<f64>
  "IQ diagram": c128[]
uses:
  NI::USRP::niUSRP Open Tx Session.gvi
  NI::USRP::niUSRP Configure Signal.gvi
  NI::USRP::niUSRP Write Tx Data (CDB).gvi
  NI::USRP::niUSRP Close Session.gvi
diagram:
  w1 = $"RF channel"
  call "niUSRP Open Tx Session.gvi"(device names=$"Device name") -> (session handle out=w2, error out=w3)
  Property Node(instance in=w2, "niUSRP"=w1, error in=w3) -> (error out=w4, instance out=w5)
  call "niUSRP Configure Signal.gvi"(active antenna=$"Active antenna", session handle=w5, error in=w4, IQ rate=$"IQ rate", carrier frequency=$"carrier frequency", gain=$gain, channel list=w1) -> (session handle out=w6, error out=w7, coerced IQ rate=w8, coerced carrier frequency=w9, coerced gain=w10)
  while {
    call "Example signal.gvi"(message length (bits)=$"message length (bits)") -> (output bit stream=w11)
    call "Transmitter.gvi"(filter parameter=$"filter parameter", filter length=$"filter length", input bit stream=w11, IQ rate=w8, Symbol rate (sym/s)=$"Symbol rate (sym/s)", Frame sync=$"Frame sync", error in=w7, Barker code=$"Barker code", Barker insert index=$"Barker insert index", encode=$encode) -> (signal out=w12, IQ diagram=w13, error out=w14)
    Divide(x=w8, y=$"Symbol rate (sym/s)") -> w15
    call "ZeroPadding.gvi"(Input=w12, Padding length=$"Padding length", samples per symbol=w15) -> (output array=w16)
    call "niUSRP Write Tx Data (CDB).gvi"(session handle=w6, error in=w14, data=w16, end of data?=$stop, channel list=w1) -> (session handle out=w17, error out=w18)
    Logical Or(w18, $stop) -> w19
    Absolute Value(x=w16) -> w20
    Reciprocal(x=$"Symbol rate (sym/s)") -> w21
    Build Waveform Node(Y=w20, dt=w21) -> (output waveform=w22)
    $"Baseband Waveform (absolute value)" <- w22
    $"IQ diagram" <- w13
    stop if w19
  }
  call "niUSRP Close Session.gvi"(session handle=w17, error in=w18) -> (error out=w23)
  $"error out" <- w23
  $"actual IQ rate" <- w8
  $"actual carrier frequency" <- w9
  $"actual gain (dB)" <- w10
